# Grasshopper definition unnamed.gh (Grasshopper 1.0.7)
# plug-ins: LadybugGrasshopper

toggle = BooleanToggle(True)  # disabled
versioner = LBVersioner(update=toggle)  # -> Vviiiiiz; disabled; plug-in component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
panel = Panel("C:\\Users\\tgerrish\\Buro Happold\\P055843 P-Dubai Expo City Masterplan - UNS - 05_Teams Files\\Sustainability and climate\\Microclimate\\data\\ARE_DU_Dubai.World.Central.Intl.AP-Maktoum.Intl.AP.411945_TMYx.epw")
concat = Concatenate(
    FragmentA="C:\Users\tgerrish\simulation\",
    FragmentB="Hospital",
    FragmentC="\openstudio\",
    FragmentD="Hospital",
    FragmentE=".hbjson")
concat_2 = Concatenate(FragmentA="C:\Users\tgerrish\simulation\", FragmentB="Hospital", FragmentC="\openstudio\simulation_parameters.json")
python = GhPythonScript(x=concat_2)  # -> a
# ---------- python: Python ----------
from honeybee_energy.simulation.parameter import SimulationParameter
import json

with open(x, "r") as fp:
    d = json.load(fp)
a = SimulationParameter.from_dict(d)
# ---------- end python ----------
concat_3 = Concatenate(FragmentA="Hospital", FragmentC="_", FragmentB="test")
loadobjects = HBLoadObjects(hb_file=concat, load=Toggle(True))  # -> report, hb_objs; plug-in component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
falsestart = LBFalseStartToggle(True)
id = HBSetIdentifier(hb_obj=loadobjects.hb_objs, id=concat_3)  # -> hb_obj; plug-in component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
modeltoosm = HBModelToOSM(model=id, epw_file=panel, sim_par=python, write=falsestart, run=falsestart)  # -> report, jsons, osw, osm, idf, sql, zsz, rdd, html; plug-in component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
roomenergyresult = HBReadRoomEnergyResult(sql=modeltoosm.sql)  # -> cooling, heating, lighting, electric_equip, gas_equip, process, hot_water, fan_electric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; plug-in component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
panel_2 = Panel(roomenergyresult.cooling)
xdata = LBDeconstructData(data=roomenergyresult.hot_water)  # -> header, values; plug-in component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
ma = MassAddition(Input=flatten(xdata.values))  # -> Result, PartialResults
panel_3 = Panel(ma.Result)
panel_4 = Panel(xdata.header)
item = ListItem(List=roomenergyresult.electric_equip, Index=Slider(0, range=0..20), Wrap=True)
eui = HBEndUseIntensity(sql=modeltoosm.sql)  # -> eui, eui_end_use, end_uses, gross_floor; plug-in component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
faceresult = HBReadFaceResult(sql=modeltoosm.sql)  # -> face_indoor_temp, face_outdoor_temp, face_energy_flow; plug-in component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
panel_6 = Panel(eui.end_uses)
loadbalance = HBThermalLoadBalance(
    rooms_model=flatten(id),
    cooling=roomenergyresult.cooling,
    heating=roomenergyresult.heating,
    lighting=roomenergyresult.lighting,
    electric_equip=roomenergyresult.electric_equip,
    gas_equip=roomenergyresult.gas_equip,
    process=roomenergyresult.process,
    hot_water=roomenergyresult.hot_water,
    people_gain=roomenergyresult.people_gain,
    solar_gain=roomenergyresult.solar_gain,
    infiltration_load=roomenergyresult.infiltration_load,
    mech_vent_load=roomenergyresult.mech_vent_load,
    nat_vent_load=roomenergyresult.nat_vent_load,
    face_energy_flow=faceresult.face_energy_flow)  # -> report, balance, balance_stor, norm_bal, norm_bal_stor; plug-in component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
python_2 = GhPythonScript(model=id, sql_file=modeltoosm.sql)  # -> out, a
# ---------- python_2: Python ----------
__author__ = "tgerrish"
__version__ = "2024.08.01"

import rhinoscriptsyntax as rs
from honeybee_energy.result.loadbalance import LoadBalance

lb = LoadBalance.from_sql_file(model=_model, sql_path=_sql_file)
a = lb.load_balance_terms(False, False)
# ---------- end python_2 ----------
panel_7 = Panel(eui.eui_end_use)
python_3 = GhPythonScript(x=roomenergyresult.hot_water)  # -> out, a
# ---------- python_3: Python ----------
__author__ = "tgerrish"
__version__ = "2024.08.01"

import rhinoscriptsyntax as rs

print(x.header.metadata['type'])
# ---------- end python_3 ----------
roomcomfortresult = HBReadRoomComfortResult(sql=modeltoosm.sql)  # -> oper_temp, air_temp, rad_temp, rel_humidity, unmet_heat, unmet_cool; plug-in component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
number_slider = Slider(8, range=0..20)
item_2 = ListItem(List=loadbalance.balance_stor, Index=number_slider, Wrap=True)
item_3 = ListItem(List=python_2.a, Index=number_slider, Wrap=True)
monthlychart = LBMonthlyChart(data=loadbalance.balance_stor, stack=Toggle(True))  # -> out, data_mesh, data_lines, col_lines, legend, borders, labels, y_title, title, vis_set; plug-in component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
xdata_2 = LBDeconstructData(data=item_2)  # -> header, values; plug-in component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
ma_2 = MassAddition(Input=xdata_2.values)  # -> Result, PartialResults
panel_8 = Panel(ma_2.Result)
xdata_3 = LBDeconstructData(data=item_3)  # -> header, values; plug-in component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
ma_3 = MassAddition(Input=xdata_3.values)  # -> Result, PartialResults
panel_9 = Panel(ma_3.Result)
panel_10 = Panel(xdata_2.header)
panel_11 = Panel(xdata_3.header)
panel_12 = Panel(xdata_2.values)
panel_13 = Panel(xdata_3.values)
